# Grasshopper definition Wave_5_posi.gh (Grasshopper 1.0.8)
# Copyright: Use it.  Mod it.  Share it. Just please give credit and keep this party going.
# Copyright: Use it.  Mod it.  Share it. Just please give credit and kepp this party going.

# ----
# Progressive Array Matrix (X,Y)
number_slider = Slider(20, range=0..100)
wave_dis = Slider(4, range=0..10)

construct_point = ConstructPoint(XCoordinate=0, YCoordinate=0, ZCoordinate=0)
unit_x = UnitX(Factor=1)
rectangle = Rectangle(Plane=PlaneXY(0, 0, 0), XSize=number_slider, YSize=number_slider, Radius=0)  # -> Rectangle, Length
division = Division(A=number_slider, B=wave_dis)
round = Round(Number=division)  # -> Nearest, Floor, Ceiling
contour = Contour(Shape=rectangle.Rectangle, Point=construct_point, Direction=unit_x, Distance=wave_dis)
panel = Panel(round.Nearest)

# ----
# Resolution Segmentation
number_slider_2 = Slider(30, range=0..100)

divide_curve = DivideCurve(Curve=contour, Count=number_slider_2, Kinks=False)  # -> Points, Tangents, Parameters

# ----
# Base Height
number_slider_3 = Slider(2, range=0..10)

# ----
# Shape Control
number_slider_4 = Slider(0.9, range=0..10)

deconstruct = Deconstruct(Point=divide_curve.Points)  # -> XComponent, YComponent, ZComponent
rectangle_2 = Rectangle(Plane=PlaneXY(0, 0, 0), XSize=Slider(20, range=0..100), YSize=Slider(20, range=0..100), Radius=0)  # -> Rectangle, Length
unit_z = UnitZ(Factor=number_slider_3)
boundary_surfaces = BoundarySurfaces(Edges=rectangle_2.Rectangle)
multiplication = Multiplication(A=deconstruct.YComponent, B=Slider(2, range=0..10))
sine = Sine(Value=multiplication)
extrude = Extrude(Base=boundary_surfaces, Direction=unit_z)

# ----
# Progressive Array Matrix (Z)
number_slider_5 = Slider(1, range=0..10)
layer_number = Slider(4, range=0..10)

multiplication_2 = Multiplication(A=sine, B=number_slider_4)
multiplication_3 = Multiplication(A=layer_number, B=panel)
cap_holes = CapHoles(Brep=extrude)
addition = Addition(A=deconstruct.XComponent, B=multiplication_2)
panel_2 = Panel(multiplication_3)
contour_2 = Contour(Shape=cap_holes, Point=Point(0, 0, 0), Direction=Vector(0, 0, 1), Distance=Slider(0.5, range=0..1))
subtraction = Subtraction(A=layer_number, B=Slider(1, range=0..1))
construct_point_2 = ConstructPoint(XCoordinate=addition, YCoordinate=deconstruct.YComponent, ZCoordinate=deconstruct.ZComponent)
series = Series(Start=0, Step=number_slider_5, Count=layer_number)

# ----
# Dynamic Kinematic Control
number_slider_6 = Slider(60, range=0..1000)

interpolate = Interpolate(Vertices=construct_point_2, Degree=3, Periodic=False, KnotStyle=1)  # -> Curve, Length, Domain
unit_z_2 = UnitZ(Factor=series)
curve_with_infill = CurveWithInfill(
    crv=contour_2,
    extrusion_width_or_xylinus_config=Slider(0.7, range=0..1),
    perimenter_wall_count=1,
    infill_ratio_0_1=Slider(0.8, range=0..1))  # -> crv_5, perimeters_and_infilll_as_polylines, perimeters, infill_2
move = Move(Geometry=interpolate.Curve, Motion=unit_z_2)  # -> Geometry, flatten(Transform)
construct_domain = ConstructDomain(DomainStart=number_slider_6, DomainEnd=Slider(196, range=0..1000))
range = Range(Domain=Domain(0, 1), Steps=subtraction)
dispatch = Dispatch(List=move.Geometry, DispatchPattern=[True, False])  # -> ListA, ListB
curve_to_g_code = CurveToGCode(crv=curve_with_infill.crv_5, tolerance_or_xylinus_config=Slider(1, range=0..1))  # -> g_code, pt_2, crv_4

# ----
# Position Refine
number_slider_7 = Slider(2, range=0..10)

flip_curve = FlipCurve(Curve=dispatch.ListB)  # -> Curve, Flag
graph_mapper = GraphMapper(range, x0=0, x1=1, y0=0, y1=1, container_name="Bezier", cpx=[0, 1, 0, 1], cpy=[0, 1, 0, 1])
weave = Weave(Pattern=[0, 1], Stream0=dispatch.ListA, Stream1=flip_curve.Curve, NullGaps=False)
concatenate = Concatenate(Fragment_A=curve_to_g_code.g_code, Fragment_B=" E0.4", A=" F800")  # -> flatten(Result)
vector_xyz = VectorXYZ(XComponent=number_slider_7, YComponent=0, ZComponent=Slider(0.2, range=0..10))  # -> Vector, Length
join_curves = JoinCurves(Curves=weave, Preserve=False)
remap_numbers = RemapNumbers(Value=graph_mapper, Source=Domain(0, 1), Target=construct_domain)  # -> Mapped, Clipped
divide_curve_2 = DivideCurve(Curve=join_curves, Count=Slider(30, range=0..40), Kinks=False)  # -> Points, Tangents, Parameters
panel_3 = Panel(concatenate)
move_2 = Move(Geometry=divide_curve_2.Points, Motion=vector_xyz.Vector)  # -> Geometry, Transform
repeat_data = RepeatData(Data=remap_numbers.Mapped, Length=panel_2)  # -> graft(Data)
shift_paths = ShiftPaths(Data=move_2.Geometry, Offset="-1")
format = Format(Format="G1 F{0:0.000}", Culture=127, Data0=repeat_data)  # -> graft(Text)
path_mapper = PathMapper(format, source="{A;B;C;D;E}", target="{A;B;C;E;D}")
deconstruct_2 = Deconstruct(Point=move_2.Geometry)  # -> XComponent, YComponent, ZComponent
list_item = ListItem(List=shift_paths, Index=Slider(0, range=0..100), Wrap=True)
panel_4 = Panel("""G0 Z5 F1200
G0 X{0:0.000} Y{1:0.000} Z{2:0.000}  """)
deconstruct_3 = Deconstruct(Point=list_item)  # -> XComponent, YComponent, ZComponent
format_2 = Format(
    Format="G1 X{0:0.000} Y{1:0.000} Z{2:0.000} E0.4",
    Culture=127,
    Data0=deconstruct_2.XComponent,
    Data1=deconstruct_2.YComponent,
    Data2=deconstruct_2.ZComponent)
format_3 = Format(
    Format=panel_4,
    Culture=127,
    Data0=deconstruct_3.XComponent,
    Data1=deconstruct_3.YComponent,
    Data2=deconstruct_3.ZComponent)
merge = Merge(Data1=format_3, Data2=path_mapper, Data3=format_2)
param_viewer = ParamViewer(format_2)
panel_5 = Panel(format_2)
panel_6 = Panel(merge)

# ==== cluster CurveToGCode: Converts a cureve into g code to 3D print with a standard filament based printer
crv = ClusterInput()
tolerance_or_xylinus_config = ClusterInput()
list = ValueList({"0", "1", "2", "3", "4", "5", "6", "7", "8", "9", "10", "11", "12", "13", "14", "15", "16", "17", "18", "19", "20"}, selected="3")
data = Data(tolerance_or_xylinus_config)
setting = ConfigSetting(config=data, setting_number=list)
xy_tolerance_mm = Number(setting)
crv_2 = Curve(crv)

# ---- group: points to gcode / set the # of decimal places included in the point to be 1 more than included in the XY resolution
split = TextSplit(Text=setting, Separators=".")
item = ListItem(List=split, Index=1, Wrap=True)
len = TextLength(Text=item)
addition = Addition(A=len, B=1)

# ---- group: points to gcode
topoly = CurveToPolyline(Curve=crv_2, ToleranceDistance=xy_tolerance_mm, ToleranceAngle=0)  # -> Polyline, Segments
explode = Explode(Curve=topoly.Polyline, Recursive=True)  # -> Segments, Vertices

# ---- group: points to gcode / set the # of decimal places included in the point to be 1 more than included in the XY resolution (continued)
roundto = CSharpScript(p=explode.Vertices, d=addition)  # -> P; inputs p: Point3d, d: Int32
# ---------- roundto: C# ----------
    Rhino.Geometry.Point3d prnd = new Rhino.Geometry.Point3d();

    prnd.X = System.Math.Round(p.X, d);
    prnd.Y = System.Math.Round(p.Y, d);
    prnd.Z = System.Math.Round(p.Z, d);
    P = prnd;
# ---------- end roundto ----------

# ----
crv_3 = Curve(topoly.Polyline)
pt = Point(roundto)

# ---- group: points to gcode (continued)
pdecon = Deconstruct(Point=roundto)  # -> XComponent, YComponent, ZComponent
format = Format(Format="G1 X{0} Y{1} Z{2}", Culture=127, Data0=pdecon.XComponent, Data1=pdecon.YComponent, Data2=pdecon.ZComponent)

# ----
g_code = ClusterOutput(format)  # Complete g code for printing a single wall model with no infill
crv_4 = ClusterOutput(crv_3)
pt_2 = ClusterOutput(pt)

# ==== cluster CurveWithInfill: Outputs polyines for W walls and infill at I density. Works for simple or complex geometries.
extrusion_width_or_xylinus_config = ClusterInput()  # input either the extrusion width in mm, or a Xlinus Config
perimenter_wall_count = ClusterInput()  # number of solid perimeter walls to print
infill_ratio_0_1 = ClusterInput()  # Set the density of the infill from 0 (none) to 1 solid).
crv = ClusterInput()
xy_tolereance_or_or_xylinus_config = ClusterInput()  # XY Tolerance

list = ValueList({"0", "1", "2", "3", "4", "5", "6", "7", "8", "9", "10", "11", "12", "13", "14", "15", "16", "17", "18", "19", "20"}, selected="4")
setting = ConfigSetting(config=extrusion_width_or_xylinus_config, setting_number=list)
extrusion_width = Number(flatten(setting))

list_2 = ValueList({"0", "1", "2", "3", "4", "5", "6", "7", "8", "9", "10", "11", "12", "13", "14", "15", "16", "17", "18", "19", "20"}, selected="2")
setting_2 = ConfigSetting(config=xy_tolereance_or_or_xylinus_config, setting_number=list_2)
xy_tol = Number(flatten(setting_2))

num = Number(infill_ratio_0_1)
int = Integer(perimenter_wall_count)
crv_2 = Curve(crv)

series = Series(Start=expr("x/2", extrusion_width), Step=extrusion_width, Count=int)
trim = TrimTree(Tree=series, Depth=1)

# ---- group: make walls
item = ListItem(List=trim, Index=0, Wrap=True)  # -> Item1, Item
addition = Addition(A=item.Item1, B=extrusion_width)

# ----
offset_cmplx = OffsetCmplx(curves_to_offset=crv_2, distance=trim)  # -> offset_curves, crv_4
offset_cmplx_2 = OffsetCmplx(curves_to_offset=crv_2, distance=addition)  # -> offset_curves, crv_4

# ---- group: infill and collate
topoly = CurveToPolyline(Curve=offset_cmplx.offset_curves, ToleranceDistance=xy_tol, ToleranceAngle=0)  # -> Polyline, Segments
infill = CurveInfill(C=offset_cmplx_2.offset_curves, extrusion_width_or_xylinus_config=extrusion_width, infill_ratio_0_1=num)
trim_to = TrimTo(data_to_trim=simplify(infill), branch_depth=1, F=False)  # -> D, input_branch_depth
trim_to_2 = TrimTo(data_to_trim=simplify(topoly.Polyline), branch_depth=1, F=False)  # -> D, input_branch_depth
merge = Merge(Data1=offset_cmplx.offset_curves, Data2=infill)
merge_2 = Merge(Data1=trim_to_2.D, Data2=trim_to.D)
crv_3 = Curve(merge)
crv_4 = Curve(merge_2)

# ----
crv_5 = ClusterOutput(crv_3)
perimeters_and_infilll_as_polylines = ClusterOutput(crv_4)  # perimeters and infilll as polylines
perimeters = ClusterOutput(trim_to_2.D)  # perimeter walls as polylines
infill_2 = ClusterOutput(infill)  # infill as polylines

# ==== cluster ConfigSetting: If an individual specific setting is input in S, it will be returned. Otherwise the config (C) setting, matching the input ID will be passed. The ID is an integer matching the branch number of the desired setting. The returned setting will have the data structure matching the input ID. Is anything other than a Xylinus Config is input to C, that data will simply be passed to S.
config = ClusterInput()
setting_number = ClusterInput()  # input an integer matching the branch number of the desired setting.
data = Data(config)
int = Integer(setting_number)

# ---- group: is it a config?
branch = TreeBranch(Tree=data, Path="{0}", MaintainPaths=True)
tmatch = MatchText(Text=branch, RegEx="config", Case=False)
int_2 = Integer(tmatch)
null = NullItem(Item=int_2)  # -> NullFlags, InvalidFlags, Description
filter = StreamFilter(Gate=null.NullFlags, Stream0=int_2, Stream1=0)

# ----
path = ConstructPath(Indices=int)

# ---- group: if so, pull the requested setting
branch_2 = TreeBranch(Tree=data, Path=path, MaintainPaths=True)

# ---- group: otherwise, just pass the input data
filter_2 = StreamFilter(Gate=filter, Stream0=data, Stream1=branch_2)
data_2 = Data(filter_2)

# ---- group: if something is passed in the Setting, use that value.
setting = ClusterInput()  # Individual specific setting. Will override the config setting.
data_3 = Data(setting)
null_coalescing = NullCoalescing(primary_data=data_3, secondary_data=data_2)

# ---- group: make the data structure match what is expected from the input
replace = ReplacePaths(Data=flatten(null_coalescing), Search="{0}", Replace=path)
setting_2 = ClusterOutput(replace)

# ==== cluster TrimTo: Trim the branches of a tree to a target length.
branch_depth = ClusterInput()  # The target branch depth. A flat terr is 0. {0} is one. {0;0} is two. etc.
data_to_trim = ClusterInput()
int = Integer(branch_depth)
data = Data(data_to_trim)
tstat = TreeStatistics(Tree=data)  # -> Paths, Length, Count
F = ClusterInput()
trim_front = Boolean(F)
split = TextSplit(Text=tstat.Paths, Separators="{;}")
empty = Text("")
mindex = MemberIndex(Set=split, Member=empty)  # -> Index, Count
cull_i = CullIndex(List=split, Indices=mindex.Index, Wrap=True)
dom = ConstructDomain(DomainStart=0, DomainEnd=expr("x-1", int))

lng = ListLength(List=cull_i)
subtraction = Subtraction(A=lng, B=int)

match = MatchTree(Tree=lng, Guide=data)
max = Maximum(A=0, B=subtraction)

dom_2 = ConstructDomain(DomainStart=max, DomainEnd=expr("x-1", lng))

filter = StreamFilter(Gate=trim_front, Stream0=dom, Stream1=dom_2)
input_branch_depth = ClusterOutput(match)
subset = SubList(List=cull_i, Domain=filter, Wrap=False)  # -> List, Index
path = ConstructPath(Indices=subset.List)  # -> flatten(Branch)
replace = ReplacePaths(Data=data, Search=tstat.Paths, Replace=path)
D = ClusterOutput(replace)

# ==== cluster CurveInfill: Take the given curve and creates an infill (based on the extrusion width and infill ratio) of the curve as a polyline. This polyline can be then be converted into g code.

C = ClusterInput()
trim_to = TrimTo_2(data_to_trim=simplify(C), branch_depth=1, F=False)
crv = Curve(trim_to)
join = JoinCurves(Curves=crv, Preserve=False)
trim = TrimTree(Tree=join, Depth=1)
boundary = BoundarySurfaces(Edges=trim)  # -> graft(Surfaces)

extrusion_width_or_xylinus_config = ClusterInput()  # input either the extrusion width in mm, or a Xlinus Config
extrusion_width = Data(extrusion_width_or_xylinus_config)
setting = ConfigSetting(config=extrusion_width, setting_number=3)  # -> flatten(setting_2)

# ---- group: infill ratio
infill_ratio_0_1 = ClusterInput()  # infill ratio
division = Division(A=1, B=infill_ratio_0_1)
multiplication = Multiplication(A=setting, B=division)

# ----
tstat = TreeStatistics(Tree=crv)  # -> Paths, Length, Count
long = LongestList(ListA=tstat.Paths, ListB=[0, 1], PaddingMode=4)  # -> ListA, simplify(graft(ListB))
larger = LargerThan(FirstNumber=tstat.Count, SecondNumber=1)  # -> LargerThan, OrEqualTo
filter = StreamFilter(Gate=larger.LargerThan, Stream0=0, Stream1=long.ListB)
trim_2 = TrimTree(Tree=boundary, Depth=1)

# ---- group: create lines for infill
bbox = BoundingBox(Content=flatten(boundary), Plane=PlaneXY(0, 0, 0), UnionBox=True)  # -> Box, Box_2
box = EvaluateBox(Box=bbox.Box, UParameter=0.5, VParameter=0.5, WParameter=0.5)  # -> Plane, Point, Include
rotate = Rotate(Geometry=bbox.Box, Angle=1.570796327, Plane=box.Plane)  # -> Geometry, Transform
bbox_2 = BoundingBox(Content=flatten([rotate.Geometry, bbox.Box]), Plane=PlaneXY(0, 0, 0), UnionBox=True)  # -> Box, Box_2
box_corners = BoxCorners(Box=flatten(bbox_2.Box))  # -> CornerA, CornerB, CornerC, CornerD, CornerE, CornerF, CornerG, CornerH
ln = Line(StartPoint=box_corners.CornerA, EndPoint=box_corners.CornerC)

# ----
ln_2 = Line(StartPoint=box_corners.CornerB, EndPoint=box_corners.CornerD)
p_n_c = PickNChoose(Pattern=filter, Stream0=ln, Stream1=ln_2)
long_2 = LongestList(ListA=trim_2, ListB=p_n_c, PaddingMode=2)  # -> ListA, graft(ListB)

# ---- group: create lines for infill (continued)
divlength = DivideLength(Curve=long_2.ListB, Length=multiplication)  # -> Points, Tangents, Parameters
pl = PlaneNormal(Origin=divlength.Points, ZAxis=long_2.ListB)
trim_3 = TrimTree(Tree=pl, Depth=1)
sec = BrepPlane(Brep=boundary, Plane=trim_3)  # -> Curves, Points
clean = CleanTree(RemoveNulls=True, RemoveInvalid=True, RemoveEmpty=True, Tree=sec.Curves)

# ----
path_mapper = PathMapper(clean, source="{A;B;C}(i)", target="{A;B;i}(C)")

# ---- group: split at nulls to establish consecutive lines
data = Data(path_mapper)
null = NullItem(Item=data)  # -> NullFlags, InvalidFlags, Description
lng = ListLength(List=data)
series = Series(Start=0, Step=1, Count=lng)
item = ListItem(List=series, Index=0, Wrap=True)  # -> Item1, Item
cull = CullPattern(List=series, CullPattern=null.NullFlags)
merge = Merge(Data1=item.Item, Data2=cull, Data3=item.Item1)
consec = ConsecutiveDomains(Numbers=merge, Additive=False)

# ----
trim_4 = TrimTree(Tree=consec, Depth=2)

# ---- group: split at nulls to establish consecutive lines (continued)
subset = SubList(List=data, Domain=trim_4, Wrap=True)  # -> List, Index
clean_2 = CleanTree(RemoveNulls=True, RemoveInvalid=True, RemoveEmpty=True, Tree=subset.List)

# ---- group: flip every other curve to make zig zags
dispatch = Dispatch(List=clean_2, DispatchPattern=[True, False])  # -> ListA, ListB
flip = FlipCurve(Curve=dispatch.ListB)  # -> Curve, Flag
weave = Weave(Pattern=[0, 1], Stream0=dispatch.ListA, Stream1=flip.Curve, NullGaps=False)
end = EndPoints(Curve=weave)  # -> Start, End
weave_2 = Weave(Pattern=[0, 1], Stream0=end.Start, Stream1=end.End, NullGaps=False)

# ---- group: split at long line shifts
data_2 = Data(weave_2)
lng_2 = ListLength(List=data_2)
series_2 = Series(Start=0, Step=1, Count=lng_2)
item_2 = ListItem(List=series_2, Index=0, Wrap=True)  # -> Item1, Item

# ---- group: split at long line shifts / if the distance between the end of one line and the start of the next is greater than X * the layer width then create a break
shift = ShiftList(List=data_2, Shift=1, Wrap=True)
dist = Distance(PointA=data_2, PointB=shift)
sift = SiftPattern(List=dist, SiftPattern=[0, 1])  # -> Output0, Output1
multiplication_2 = Multiplication(A=multiplication, B=Slider(2.5, range=0..10))
larger_2 = LargerThan(FirstNumber=sift.Output1, SecondNumber=multiplication_2)  # -> LargerThan, OrEqualTo

# ---- group: split at long line shifts
replace = ReplaceItems(List=larger_2.LargerThan, Item=True, Indices=-1, Wrap=True)
trim_5 = TrimTree(Tree=replace, Depth=1)

cull_2 = CullPattern(List=series_2, CullPattern=trim_5)
merge_2 = Merge(Data1=item_2.Item, Data2=cull_2)
consec_2 = ConsecutiveDomains(Numbers=merge_2, Additive=False)

# ---- group: split at long line shifts / increase start of domain by one unless it is 0
dedomain = DeconstructDomain(Domain=consec_2)  # -> Start, End
addition = Addition(A=dedomain.Start, B=1)
eval = Evaluate(F="if(x=1,0,x)", x=addition)
dom = ConstructDomain(DomainStart=eval, DomainEnd=dedomain.End)

# ---- group: split at long line shifts
trim_6 = TrimTree(Tree=dom, Depth=2)
subset_2 = SubList(List=data_2, Domain=trim_6, Wrap=False)  # -> List, Index
clean_3 = CleanTree(Tree=subset_2.List, CleanInvalid=True, CleanEmpty=False)
prune = PruneTree(Tree=clean_3, Minimum=1, Maximum=0)
pline = PolyLine(Vertices=prune, Closed=False)
trim_to_2 = TrimTo_2(data_to_trim=pline, branch_depth=1, F=False)
D = ClusterOutput(trim_to_2)

# ==== cluster OffsetCmplx: Offset curves, with automatic detection of internal vs. external geometry.
distance = ClusterInput()  # distance to offset the curve(s)
curves_to_offset = ClusterInput()
crv = Curve(curves_to_offset)

# ---- group: find which curves are interior and which are exterior
# note: there is a bunch of data juggling here because simply grafting one input does not distrubite this operation like is most GH components.
clean = CleanTree(Tree=crv, CleanInvalid=True, CleanEmpty=True)
crv_2 = Curve(clean)
curvepoint = PointOnCurve(crv_2, parameter=0.286)
crossref = CrossReference(ListA=crv_2, ListB=curvepoint, CrossMode=1)  # -> ListA, ListB
incurve = PointInCurve(Point=graft(crossref.ListB), Curve=graft(crossref.ListA))  # -> Relationship, Point
trim = TrimTree(Tree=incurve.Relationship, Depth=1)
lng = ListLength(List=trim)
sqrt = SquareRoot(Value=lng)
partition = PartitionList(List=trim, Size=sqrt)
bnd = Bounds(Numbers=partition)
dedomain = DeconstructDomain(Domain=bnd)  # -> Start, End
trim_2 = TrimTree(Tree=dedomain.End, Depth=1)
smaller = SmallerThan(FirstNumber=trim_2, SecondNumber=1)  # -> SmallerThan, OrEqualTo
dispatch = Dispatch(List=crv_2, DispatchPattern=smaller.OrEqualTo)  # -> ListA, ListB

# ----
distance_2 = Number(distance)

# ---- group: Case 3 : muliptle collections of curves and multiple distances
distance_3 = Number(flatten(distance_2))
outside_crvs = Curve(dispatch.ListA)
inside_crvs = Curve(dispatch.ListB)
trim_to = TrimTo_2(data_to_trim=simplify(inside_crvs), branch_depth=1, F=False)  # -> graft(D)
trim_to_2 = TrimTo_2(data_to_trim=simplify(outside_crvs), branch_depth=1, F=False)  # -> graft(D)
crossref_2 = CrossReference(ListA=trim_to, ListB=distance_3, CrossMode=1)  # -> ListA, ListB
crossref_3 = CrossReference(ListA=trim_to_2, ListB=distance_3, CrossMode=1)  # -> ListA, ListB
offset_out = OffsetOut(curve=crossref_2.ListA, distance=crossref_2.ListB, corner_style=3)  # -> crv_5, possibly_problematic_curves
offset_in = OffsetIn(curve=crossref_3.ListA, distance=crossref_3.ListB, corner_style=3)  # -> offset_cruves, possibly_problematic_curves
crv_3 = Curve([offset_in.possibly_problematic_curves, offset_out.possibly_problematic_curves])
crv_4 = ClusterOutput(crv_3)

# ---- group: Case 3 : muliptle collections of curves and multiple distances / replace problematic curves with chamfered corner curves
offset_in_2 = OffsetIn(curve=offset_in.possibly_problematic_curves, distance=crossref_3.ListB, corner_style=Slider(4, range=0..10))  # -> offset_cruves, possibly_problematic_curves
null = NullItem(Item=offset_in_2.offset_cruves)  # -> NullFlags, InvalidFlags, Description
weave = Weave(Pattern=null.NullFlags, Stream0=offset_in_2.offset_cruves, Stream1=offset_in.offset_cruves, NullGaps=False)
crv_5 = Curve(weave)

# ---- group: Case 3 : muliptle collections of curves and multiple distances / placeholder when there is not internal crvs
lng_2 = ListLength(List=distance_3)
null_2 = Null()
repeat = RepeatData(Data=null_2, Length=lng_2)
null_3 = NullItem(Item=offset_out.crv_5)  # -> NullFlags, InvalidFlags, Description
weave_2 = Weave(Pattern=null_3.NullFlags, Stream0=offset_out.crv_5, Stream1=repeat, NullGaps=False)

# ---- group: Case 3 : muliptle collections of curves and multiple distances (continued)
path_mapper = PathMapper(weave_2, source="{A;B}(i)", target="{A;i}(B)")
path_mapper_2 = PathMapper(crv_5, source="{A;B}(i)", target="{A;i}(B)")
clean_2 = CleanTree(RemoveNulls=True, RemoveInvalid=True, RemoveEmpty=False, Tree=path_mapper)
crv_6 = Curve(clean_2)
runion = RegionUnion(Curves=crv_6)
null_4 = NullItem(Item=runion)  # -> NullFlags, InvalidFlags, Description
weave_3 = Weave(Pattern=null_4.NullFlags, Stream0=runion, Stream1=crv_6, NullGaps=False)
trim_3 = TrimTree(Tree=weave_3, Depth=1)
crv_7 = Curve([path_mapper_2, trim_3])
rdiff = RegionDifference(CurvesA=path_mapper_2, CurvesB=trim_3)
null_5 = NullItem(Item=rdiff)  # -> NullFlags, InvalidFlags, Description
weave_4 = Weave(Pattern=null_5.NullFlags, Stream0=rdiff, Stream1=crv_7, NullGaps=False)
trim_to_3 = TrimTo_2(data_to_trim=weave_4, branch_depth=1, F=False)

len = Length(Curve=trim_to_3)
sort = SortList(Keys=len, ValuesA=trim_to_3)  # -> Keys, reverse(ValuesA)
split = SplitList(List=sort.ValuesA, Index=1)  # -> ListA, ListB
end = EndPoints(Curve=split.ListA)  # -> Start, End
crv_cp = CurveClosestPoint(Point=end.Start, Curve=split.ListB)  # -> Point, Parameter, Distance
sort_2 = SortList(Keys=crv_cp.Distance, ValuesA=split.ListB)  # -> Keys, ValuesA
merge = Merge(Data1=split.ListA, Data2=sort_2.ValuesA)  # -> simplify(Result)

crv_8 = Curve(merge)
offset_curves = ClusterOutput(crv_8)

# ==== cluster NullCoalescing: Passes the primary data input, unless it is null. In which case it passes the secondary data input to the output. (Like the ?? operator in C#)
primary_data = ClusterInput()  # If this input is not null, it will be passed tot he output.
secondary_data = ClusterInput()  # If the input to the primary data is null, this will be passed to the output.
data = Data(primary_data)
data_2 = Data(secondary_data)
null = NullItem(Item=data)  # -> NullFlags, InvalidFlags, Description
filter = StreamFilter(Gate=null.NullFlags, Stream0=data, Stream1=data_2)
data_3 = Data(filter)
data_4 = ClusterOutput(data_3)

# ==== cluster TrimTo_2: Trim the branches of a tree to a target length.
branch_depth = ClusterInput()  # The target branch depth. A flat terr is 0. {0} is one. {0;0} is two. etc.
data_to_trim = ClusterInput()
int = Integer(branch_depth)
data = Data(data_to_trim)
tstat = TreeStatistics(Tree=data)  # -> Paths, Length, Count
F = ClusterInput()
trim_front = Boolean(F)
split = TextSplit(Text=tstat.Paths, Separators="{;}")
empty = Text("")
mindex = MemberIndex(Set=split, Member=empty)  # -> Index, Count
cull_i = CullIndex(List=split, Indices=mindex.Index, Wrap=True)
dom = ConstructDomain(DomainStart=0, DomainEnd=expr("x-1", int))

lng = ListLength(List=cull_i)
subtraction = Subtraction(A=lng, B=int)

max = Maximum(A=0, B=subtraction)

dom_2 = ConstructDomain(DomainStart=max, DomainEnd=expr("x-1", lng))

filter = StreamFilter(Gate=trim_front, Stream0=dom, Stream1=dom_2)
subset = SubList(List=cull_i, Domain=filter, Wrap=False)  # -> List, Index
path = ConstructPath(Indices=subset.List)  # -> flatten(Branch)
replace = ReplacePaths(Data=data, Search=tstat.Paths, Replace=path)
D = ClusterOutput(replace)

# ==== cluster OffsetIn: Offsets curves inward. Use for extranal curves.
curve = ClusterInput()  # Offset curves inward. Use for exterior curves.
distance = ClusterInput()  # Distance(s) to offset curve(s)
corner_style = ClusterInput()

# ---- group: if fed a config use 1/2 extrusion width, otherwise pass data
distance_2 = Number(distance)

# ---- group: exterior
crv = Curve(curve)

# ---- group: run a test offset and check to see if it is smaller
D = Number(distance_2)
offset = Offset(Curve=crv, Distance=D, Plane=PlaneXY(0, 0, 0), Corners=corner_style)
trim = TrimTree(Tree=offset, Depth=1)
area = Area(Geometry=trim)  # -> Area, Centroid
area_2 = Area(Geometry=crv)  # -> Area, Centroid
smaller = SmallerThan(FirstNumber=area.Area, SecondNumber=area_2.Area)  # -> SmallerThan, OrEqualTo

# ---- group: use test offset to determine the direction of the final offset
D_2 = Number(distance_2)
long = LongestList(ListA=smaller.SmallerThan, ListB=D_2, PaddingMode=2)  # -> ListA, ListB
neg = Negative(Value=long.ListB)
p_n_c = PickNChoose(Pattern=smaller.SmallerThan, Stream0=neg, Stream1=long.ListB)
offset_2 = Offset(Curve=crv, Distance=p_n_c, Plane=PlaneXY(0, 0, 0), Corners=corner_style)
trim_2 = TrimTree(Tree=offset_2, Depth=1)

# ---- group: double check and just ditch what isn't right
area_3 = Area(Geometry=trim_2)  # -> Area, Centroid
area_4 = Area(Geometry=crv)  # -> Area, Centroid
smaller_2 = SmallerThan(FirstNumber=area_3.Area, SecondNumber=area_4.Area)  # -> SmallerThan, OrEqualTo
dispatch = Dispatch(List=trim_2, DispatchPattern=smaller_2.SmallerThan)  # -> ListA, ListB
crv_2 = Curve(dispatch.ListB)

# ---- group: double check and just ditch what isn't right / good exterior offsets
crv_3 = Curve(dispatch.ListA)

# ----
offset_cruves = ClusterOutput(crv_3)

bnd = Bounds(Numbers=flatten(distance_2))
pi = Pi(Factor=1)
dedomain = DeconstructDomain(Domain=bnd)  # -> Start, End
len = Length(Curve=crv_3)
len_2 = Length(Curve=crv)
multiplication = Multiplication(A=dedomain.End, B=pi)
division = Division(A=len, B=len_2)
larger = LargerThan(FirstNumber=division, SecondNumber=0.5)  # -> LargerThan, OrEqualTo

smaller_3 = SmallerThan(FirstNumber=len, SecondNumber=multiplication)  # -> SmallerThan, OrEqualTo

or = GateOr(A=larger.LargerThan, B=smaller_3.SmallerThan)
dispatch_2 = Dispatch(List=crv, DispatchPattern=or)  # -> ListA, ListB
crv_4 = Curve(dispatch_2.ListB)
possibly_problematic_curves = ClusterOutput(crv_4)  # These are the orginal input curves whose offset resulted in a crv that was less than 50% of the original length (and not simply due to strating as a small curve.

# ==== cluster OffsetOut: Offset curves outward. Use for interior curves.
curve = ClusterInput()  # Offset curves inward. Use for exterior curves.
distance = ClusterInput()  # Distance(s) to offset curve(s)
corner_style = ClusterInput()
distance_2 = Number(distance)

# ---- group: interior
crv = Curve(curve)

# ---- group: run a test offset and check to see if it is bigger
D = Number(distance_2)
offset = Offset(Curve=crv, Distance=D, Plane=PlaneXY(0, 0, 0), Corners=corner_style)
trim = TrimTree(Tree=offset, Depth=1)
area = Area(Geometry=trim)  # -> Area, Centroid
area_2 = Area(Geometry=crv)  # -> Area, Centroid
larger = LargerThan(FirstNumber=area.Area, SecondNumber=area_2.Area)  # -> LargerThan, OrEqualTo

# ---- group: use test offset to determine the direction of the final offset
D_2 = Number(distance_2)
long = LongestList(ListA=larger.LargerThan, ListB=D_2, PaddingMode=2)  # -> ListA, ListB
neg = Negative(Value=long.ListB)
p_n_c = PickNChoose(Pattern=larger.LargerThan, Stream0=neg, Stream1=long.ListB)
offset_2 = Offset(Curve=crv, Distance=p_n_c, Plane=PlaneXY(0, 0, 0), Corners=corner_style)
trim_2 = TrimTree(Tree=offset_2, Depth=1)

# ---- group: double check and just ditch what isn't right
area_3 = Area(Geometry=trim_2)  # -> Area, Centroid
area_4 = Area(Geometry=crv)  # -> Area, Centroid
larger_2 = LargerThan(FirstNumber=area_3.Area, SecondNumber=area_4.Area)  # -> LargerThan, OrEqualTo
dispatch = Dispatch(List=trim_2, DispatchPattern=larger_2.LargerThan)  # -> ListA, ListB
crv_2 = Curve(dispatch.ListB)

# ---- group: double check and just ditch what isn't right / good interior offsets
crv_3 = Curve(dispatch.ListA)

# ----
len = Length(Curve=crv_3)
len_2 = Length(Curve=crv)
bnd = Bounds(Numbers=distance_2)
pi = Pi(Factor=1)
dedomain = DeconstructDomain(Domain=bnd)  # -> Start, End
division = Division(A=len, B=len_2)
larger_3 = LargerThan(FirstNumber=division, SecondNumber=0.5)  # -> LargerThan, OrEqualTo
multiplication = Multiplication(A=dedomain.End, B=pi)
or = GateOr(A=larger_3.LargerThan, B=multiplication)
dispatch_2 = Dispatch(List=crv, DispatchPattern=or)  # -> ListA, ListB
crv_4 = Curve(dispatch_2.ListB)
possibly_problematic_curves = ClusterOutput(crv_4)  # These are the orginal input curves whose offset resulted in a crv that was less than 50% of the original length.

crv_5 = ClusterOutput(crv_3)
